# Grasshopper definition 00_install.ghx (Grasshopper 1.0.8)

# Installation
# This may take up to a minute
install = Python3Script()  # -> out
# ---------- install: Python ----------
#! python 3
# venv: foc26_utc
# r: compas, compas_cgal, pymeshfix
import compas
import compas_cgal
import pymeshfix

print("venv: foc26_utc")
print(f"compas: {compas.__version__}")
print(f"compas_cgal: {compas_cgal.__version__}")
print(f"pymeshfix: {pymeshfix.__version__}")
# ---------- end install ----------
panel = Panel(install)
