# Grasshopper definition 01_database.ghx (Grasshopper 1.0.8)

# ----
# Download obj files to your data folder
# - set boolean to true
# - this may take up to 3 minutes
# - find the .obj files in: .../under-the-canopy/data/branches/
# - close the file when done
boolean_toggle = BooleanToggle(False)
database = Python3Script(download=boolean_toggle, branch_count="96")  # -> out, summary; inputs download: Boolean, branch_count: Int32
# ---------- database: Python ----------
#! python 3
# venv: foc26_utc

#locate file in the same folder
import sys
import os
from compas_rhino import unload_modules

#get current file path
path = ghenv.Component.OnPingDocument().FilePath
print (path)
#get parent directory of the parent directory
parentdir = os.path.dirname(path)
print (parentdir)
#get root directory of the parent directory
root = os.path.dirname(parentdir)
print (root)
#get src folder
dire = os.path.join(parentdir,'src')
print (dire)
#get data folder
data_dir = os.path.join(root,'data')
print (data_dir)

sys.path.append(dire)

unload_modules('database')

from database import run_script, print_results_report

download_folder = os.path.join(data_dir,'branches')
f, n, fld, r = run_script(cache_folder=download_folder, download=download, branch_count=branch_count)

summary = print_results_report(f, n, fld, r)
# ---------- end database ----------
panel = Panel(database.summary)
