# Grasshopper definition 02_branch_overview.ghx (Grasshopper 1.0.8)
# plug-ins: Pufferfish

# ----
# Load obj files your data folder
# and create Mesh
# - choose to include the bf and/or gb dataset (this will increase computation time)
# - set the load mesh to true
# - this may take up to 1 min / 2 min with gb + bf
boolean_toggle = BooleanToggle(False)
loadmesh = Python3Script(load_mesh=boolean_toggle, bf=Toggle(False), gb=Toggle(False))  # -> out, mesh, ID; inputs load_mesh: Boolean
# ---------- loadmesh: Python ----------
#! python 3
# venv: foc26_utc

#locate file in the same folder
from compas_rhino import unload_modules
import sys
import os

#get current file path
path = ghenv.Component.OnPingDocument().FilePath
print (path)
#get parent directory of the parent directory
parentdir = os.path.dirname(path)
print (parentdir)
#get src folder which contains classes
dire = os.path.join(parentdir,'src')
print (dire)

sys.path.append(dire)

unload_modules('mesh_utils')

from mesh_utils import load_branch_meshes


if load_mesh:
    mesh, ID = load_branch_meshes(load_bf=bf, load_gb=gb)
# ---------- end loadmesh ----------

# ----
# Pre-process
# - press the play button
# - this may take up to 2 min / 5 min when gb + pf
data_dam = DataDam(DataDataA=loadmesh.mesh, DataDataB=loadmesh.ID, BufferDelay=10000000, BufferMode=0)  # -> DataDataA, DataDataB
repair = Python3Script(mesh=data_dam.DataDataA)  # -> out, mesh_out; inputs mesh: list
# ---------- repair: Python ----------
#! python 3
# venv: foc26_utc

#locate file in the same folder
from compas_rhino import unload_modules
import sys
import os

#get current file path
path = ghenv.Component.OnPingDocument().FilePath
print (path)
#get parent directory of the parent directory
parentdir = os.path.dirname(path)
print (parentdir)
#get src folder which contains classes
dire = os.path.join(parentdir,'src')
print (dire)

sys.path.append(dire)

unload_modules('mesh_utils')

from mesh_utils import load_branch_meshes
import pymeshfix
from compas.datastructures import Mesh
import numpy as np
from compas_cgal.meshing import trimesh_remesh

if mesh[0]:

    mesh_cgal = [trimesh_remesh(mesh_in.to_vertices_and_faces(triangulated=True), 10.0) for mesh_in in mesh]

    mesh_cgal = [Mesh.from_vertices_and_faces(*m) for m in mesh_cgal]

    mesh_out = []
    for m in mesh_cgal:
        vertices, faces = m.to_vertices_and_faces(triangulated=True)

        vertices = np.asarray(vertices, dtype=np.float64)
        faces = np.asarray(faces, dtype=np.int32)

        mf = pymeshfix.MeshFix(vertices, faces)

        # main repair routine
        mf.repair(
            verbose=True,
            joincomp=True,
            remove_smallest_components=True,
        )

        vclean = mf.v
        fclean = mf.f

        mesh_out.append(Mesh.from_vertices_and_faces(vclean, fclean))
# ---------- end repair ----------
preprocess = Python3Script(mesh=repair.mesh_out)  # -> out, mesh_origin, is_fork, angle, height, width, asymmetry; inputs mesh: list
# ---------- preprocess: Python ----------
#! python 3
# venv: foc26_utc

#locate file in the same folder
from compas_rhino import unload_modules
from compas_rhino.conversions import mesh_to_compas, vector_to_rhino, point_to_rhino
import sys
import os
from ghpythonlib.treehelpers import list_to_tree

import compas_cgal

print(compas_cgal.__version__)

#get current file path
path = ghenv.Component.OnPingDocument().FilePath
print (path)
#get parent directory of the parent directory
parentdir = os.path.dirname(path)
print (parentdir)
#get src folder which contains classes
dire = os.path.join(parentdir,'src')
print (dire)

sys.path.append(dire)

unload_modules('branch')
unload_modules('mesh_utils')
unload_modules('graph_utils')
unload_modules('centerline')


from branch import Branch
import mesh_utils
import graph_utils

from compas.geometry import Polyline, Line

mesh_origin = []
angle = []
height = []
width = []
asymmetry = []

if mesh[0]:
    for m in mesh:

        branch = Branch(m)
        branch.preprocess()
        mesh_origin.append(branch.mesh)
        bifurcation_angle = branch.skeleton_bifurcation_angle() if branch.is_bifurcation else None
        angle.append(bifurcation_angle)
        height.append(branch.height())
        width.append(branch.width())
        if branch.is_bifurcation:
            angle_01, angle_12, angle_02 = branch.skeleton_bifurcation_angles()
            asymmetry.append(abs(angle_01 - angle_02))
        else:
            asymmetry.append(None)
# ---------- end preprocess ----------
compas_draw = COMPASDraw(cg=preprocess.mesh_origin)  # -> rg
#   port cg: The COMPAS geometry or datastructure to be drawn.
#   port rg: The Rhino geometry object.
# ---------- compas_draw: Python ----------
# r: compas>=2.8.1
"""
Draws COMPAS geometry in Grasshopper.
"""

from typing import Any

import Grasshopper

from compas.scene import SceneObject


class CompasToRhinoGeometry(Grasshopper.Kernel.GH_ScriptInstance):
    def RunScript(self, cg):
        if not cg:
            return None

        return SceneObject(item=cg).draw()
# ---------- end compas_draw ----------

sorting_attribute = Data(preprocess.angle)

grid_size = Slider(15, range=2..15)
distance = Slider(1750, range=500..1800)

# ----
# Arrange
# - creates layout for branches
# - insert attribute of your choice
# in "sorting attribute"
xz_plane = XZPlane(Origin=Point(0, 0, 0))
sort_list = SortList(Keys=sorting_attribute, ValuesValuesA=compas_draw, ValuesValuesB=data_dam.DataDataB)  # -> Keys, ValuesValuesA, ValuesValuesB
rectangular = Rectangular(Plane=xz_plane, SizeX=distance, SizeY=distance, ExtentX=grid_size, ExtentY=grid_size)  # -> Cells, Points
list_length = ListLength(List=compas_draw)
data = Data(sort_list.Keys)
mesh = Mesh(sort_list.ValuesValuesA)
id = Data(sort_list.ValuesValuesB)
point = Point(flatten(rectangular.Points))
series = Series(Start=0, Step=1, Count=list_length)
area = Area(Geometry=mesh)  # -> Area, Centroid
list_item = ListItem(List=point, Index=series, Wrap=True)
move_to_point = MoveToPoint(Geometry=mesh, PointA=area.Centroid, PointB=list_item)  # -> Moved, Vector, Transform

# ----
# Color
bounds = Bounds(Numbers=sorting_attribute)
deconstruct_domain = DeconstructDomain(Domain=bounds)  # -> Start, End
gradient = Gradient(
    LowerLimit=deconstruct_domain.Start,
    UpperLimit=deconstruct_domain.End,
    Parameter=data,
    stops=[0: RGB(0, 98, 0), 0.25: RGB(81, 175, 17), 0.5: RGB(159, 198, 146), 0.75: RGB(170, 235, 41), 1: RGB(221, 255, 53)])
mesh_2 = Mesh(move_to_point.Moved)
custom_preview = CustomPreview(Geometry=mesh_2, Material=gradient)

# ----
# Branch ID
multiplication = Multiplication(A=distance, B=0.5)
subtraction = Subtraction(A=distance, B=multiplication)
unit_z = UnitZ(Factor=expr("x*-1", subtraction))
addition = Addition(A=move_to_point.Vector, B=unit_z)
text_tag = TextTag(Location=addition, Text=id, Colour=ColourSwatch(SwatchColor=RGB(0, 93, 255)))
