# Grasshopper definition 03_centerline.ghx (Grasshopper 1.0.8)
# plug-ins: Pufferfish

# ----
# Load mesh from data folder
branch_id = Slider(13, range=1..52)
# - set the boolean toggle to true
# - or take an example mesh from the next box
boolean_toggle = BooleanToggle(False)
loadmesh = Python3Script(load_mesh=boolean_toggle, branch_id=branch_id)  # -> out, mesh, ID; inputs load_mesh: Boolean, branch_id: Int32
# ---------- loadmesh: Python ----------
#! python 3
# venv: foc26_utc

#locate file in the same folder
from compas_rhino import unload_modules
import sys
import os

#get current file path
path = ghenv.Component.OnPingDocument().FilePath
print (path)
#get parent directory of the parent directory
parentdir = os.path.dirname(path)
print (parentdir)
#get src folder which contains classes
dire = os.path.join(parentdir,'src')
print (dire)

sys.path.append(dire)

unload_modules('mesh_utils')

from mesh_utils import load_branch_meshes


if load_mesh:
    mesh, ID = load_branch_meshes(branch_id)
# ---------- end loadmesh ----------
repair = Python3Script(mesh=loadmesh.mesh)  # -> out, mesh_out; inputs mesh: list
# ---------- repair: Python ----------
#! python 3
# venv: foc26_utc

#locate file in the same folder
from compas_rhino import unload_modules
import sys
import os

#get current file path
path = ghenv.Component.OnPingDocument().FilePath
print (path)
#get parent directory of the parent directory
parentdir = os.path.dirname(path)
print (parentdir)
#get src folder which contains classes
dire = os.path.join(parentdir,'src')
print (dire)

sys.path.append(dire)

unload_modules('mesh_utils')

from mesh_utils import load_branch_meshes
import pymeshfix
from compas.datastructures import Mesh
import numpy as np
from compas_cgal.meshing import trimesh_remesh


if mesh[0]:
    mesh_cgal = [trimesh_remesh(mesh_in.to_vertices_and_faces(triangulated=True), 10.0) for mesh_in in mesh]

    mesh_cgal = [Mesh.from_vertices_and_faces(*m) for m in mesh_cgal]

    mesh_out = []
    for m in mesh_cgal:
        vertices, faces = m.to_vertices_and_faces(triangulated=True)

        vertices = np.asarray(vertices, dtype=np.float64)
        faces = np.asarray(faces, dtype=np.int32)

        mf = pymeshfix.MeshFix(vertices, faces)

        # main repair routine
        mf.repair(
            verbose=True,
            joincomp=True,
            remove_smallest_components=True,
        )

        vclean = mf.v
        fclean = mf.f

        mesh_out.append(Mesh.from_vertices_and_faces(vclean, fclean))
# ---------- end repair ----------

# ----
# Branch input (mesh)
# - wire a mesh into TriRemsh
number_slider = Slider(10, range=0..10)
tubular_mesh_example = Mesh(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)
fork_mesh_example = Mesh(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)
compas_draw = COMPASDraw(cg=repair.mesh_out)  # -> rg
#   port cg: The COMPAS geometry or datastructure to be drawn.
#   port rg: The Rhino geometry object.
# ---------- compas_draw: Python ----------
# r: compas>=2.8.1
"""
Draws COMPAS geometry in Grasshopper.
"""

from typing import Any

import Grasshopper

from compas.scene import SceneObject


class CompasToRhinoGeometry(Grasshopper.Kernel.GH_ScriptInstance):
    def RunScript(self, cg):
        if not cg:
            return None

        return SceneObject(item=cg).draw()
# ---------- end compas_draw ----------
triremesh = TriRemesh(Length=number_slider, Iterations=25)  # -> Triangulation, Dual, Creases

# ----
# 1. Pre-Process
# Pre-Process outputs
# mesh transformed to origin:
# bounding box:
# is fork:
preprocess = Python3Script(mesh=triremesh.Triangulation)  # -> out, branch, mesh_origin, bounding_box, is_fork; inputs mesh: Mesh
# ---------- preprocess: Python ----------
#! python 3
# venv: foc26_utc

#locate file in the same folder
from compas_rhino import unload_modules
from compas_rhino.conversions import mesh_to_compas, vector_to_rhino, point_to_rhino
import sys
import os

import compas_cgal

print(compas_cgal.__version__)

#get current file path
path = ghenv.Component.OnPingDocument().FilePath
print (path)
#get parent directory of the parent directory
parentdir = os.path.dirname(path)
print (parentdir)
#get src folder which contains classes
dire = os.path.join(parentdir,'src')
print (dire)

sys.path.append(dire)

unload_modules('branch')
unload_modules('mesh_utils')
unload_modules('graph_utils')
unload_modules('centerline')


from branch import Branch
import mesh_utils
import graph_utils

from compas.geometry import Polyline, Line

if mesh:

    c_mesh = mesh_to_compas(mesh)

    branch = Branch(c_mesh)
    branch.preprocess()
    mesh_origin = branch.mesh
    bounding_box = branch.bounding_box()
    centerline = branch.skeleton_polylines()
    is_fork = True if branch.number_of_end_points() > 2 else False
# ---------- end preprocess ----------
compas_draw_2 = COMPASDraw(cg=preprocess.mesh_origin)  # -> rg; same code as compas_draw
compas_draw_3 = COMPASDraw(cg=preprocess.bounding_box)  # -> rg; same code as compas_draw
fork = Panel(preprocess.is_fork)

# ----
# Debugging info
# Debugging outputs
# skeleton:
# skeleton bifurcation node (pt):
# computed bifurcation point:
# bifurcation angle (degrees):
# bifurcation graph (lines):
# geometric contours:
# maximum inscribed circle:
debug = Python3Script(branch=preprocess.branch)  # -> out, skeleton, skeleton_bifurcation_pt, computed_bifurcation_pt, bifurcation_angle, bifurcation_graph, contours, max_inscribed_circles; disabled
# ---------- debug: Python ----------
#locate file in the same folder
from compas_rhino import unload_modules
from compas_rhino.conversions import mesh_to_compas, vector_to_rhino, point_to_rhino
import sys
import os

from ghpythonlib.treehelpers import list_to_tree

import compas_cgal

print(compas_cgal.__version__)

#get current file path
path = ghenv.Component.OnPingDocument().FilePath
print (path)
#get parent directory of the parent directory
parentdir = os.path.dirname(path)
print (parentdir)
#get src folder which contains classes
dire = os.path.join(parentdir,'src')
print (dire)

sys.path.append(dire)

unload_modules('branch')
unload_modules('mesh_utils')
unload_modules('graph_utils')
unload_modules('growth_center')


from branch import Branch
import mesh_utils
import graph_utils
import growth_center

if branch.is_bifurcation:
    skeleton_trunk = branch.skeleton_trunk_lines()
    skeleton_axis_1, skeleton_axis_2 = branch.skeleton_branching_lines()
    skeleton = [skeleton_trunk, skeleton_axis_1, skeleton_axis_2]
else:
    skeleton = branch.skeleton_polylines()


skeleton_bifurcation_pt = branch.bifurcation_point() if branch.is_bifurcation else None

computed_bifurcation_pt = branch.compute_bifurcation_point(tolerance=5.0) if branch.is_bifurcation else None

bifurcation_angle = branch.skeleton_bifurcation_angle() if branch.is_bifurcation else None

bifurcation_graph = branch.true_bifurcation_graph_lines() if branch.is_bifurcation else None

if branch.is_bifurcation:
    contours_dict = branch._contours(graph=branch.true_bifurcation_graph(), resolution=30.0)
    contours = [contours_dict[0], contours_dict[1], contours_dict[2]]
    contours = list_to_tree(contours)
else:
    contours = branch._contours_tubular(graph=branch.tubular_skeleton_graph(), resolution=30.0)

_, max_inscribed_circles = branch.growth_centerline()
max_inscribed_circles = list_to_tree(max_inscribed_circles)
# ---------- end debug ----------
compas_draw_4 = COMPASDraw(cg=debug.skeleton)  # -> rg; disabled; same code as compas_draw
compas_draw_5 = COMPASDraw(cg=debug.skeleton_bifurcation_pt)  # -> rg; disabled; same code as compas_draw
compas_draw_6 = COMPASDraw(cg=debug.computed_bifurcation_pt)  # -> rg; disabled; same code as compas_draw
compas_draw_7 = COMPASDraw(cg=debug.bifurcation_graph)  # -> rg; disabled; same code as compas_draw
compas_draw_8 = COMPASDraw(cg=debug.contours)  # -> rg; disabled; same code as compas_draw
compas_draw_9 = COMPASDraw(cg=debug.max_inscribed_circles)  # -> rg; disabled; same code as compas_draw
panel = Panel(debug.bifurcation_angle)  # disabled

# ----
# 2. Centerline
# Centerline outputs
# geometric centerline:
# geometric sections (contours):
# growth centerline:
# circular sections (contours):
# bifurcation point:
# circular sections diameter:
centerline = Python3Script(branch=preprocess.branch)  # -> out, geometric_centerline, geometric_section, growth_centerline, circular_section, section_diameter, bifurcation_point
# ---------- centerline: Python ----------
#! python 3
# venv: foc26_utc

#locate file in the same folder
from compas_rhino import unload_modules
from compas_rhino.conversions import mesh_to_compas, vector_to_rhino, point_to_rhino
import sys
import os

from ghpythonlib.treehelpers import list_to_tree

import compas_cgal

print(compas_cgal.__version__)

#get current file path
path = ghenv.Component.OnPingDocument().FilePath
print (path)
#get parent directory of the parent directory
parentdir = os.path.dirname(path)
print (parentdir)
#get src folder which contains classes
dire = os.path.join(parentdir,'src')
print (dire)

sys.path.append(dire)

unload_modules('branch')
unload_modules('mesh_utils')
unload_modules('graph_utils')
unload_modules('growth_center')


from branch import Branch
import mesh_utils
import graph_utils
import growth_center

from compas.geometry import Polyline, Line

if branch:
    
    bifurcation_point = branch.compute_bifurcation_point() if branch.is_bifurcation else None

    geometric_centerline, sections_geometric = branch.geometric_centerline()
    growth_centerline, sections_circular = branch.growth_centerline()
    geometric_section = list_to_tree(sections_geometric)
    section_diameter = []
    for axis in sections_circular:
        if branch.is_bifurcation:
            axis_diameters = []
            for c in axis:
                axis_diameters.append(c.radius * 2)
            section_diameter.append(axis_diameters)
        else:
            section_diameter.append(axis.radius * 2)

    circular_section = list_to_tree(sections_circular)
    section_diameter = list_to_tree(section_diameter)
# ---------- end centerline ----------
compas_draw_10 = COMPASDraw(cg=centerline.geometric_centerline)  # -> rg; same code as compas_draw
compas_draw_11 = COMPASDraw(cg=centerline.geometric_section)  # -> rg; same code as compas_draw
compas_draw_12 = COMPASDraw(cg=centerline.growth_centerline)  # -> rg; same code as compas_draw
compas_draw_13 = COMPASDraw(cg=centerline.circular_section)  # -> rg; same code as compas_draw
compas_draw_14 = COMPASDraw(cg=centerline.bifurcation_point)  # -> rg; same code as compas_draw
diameters_branch = Panel(centerline.section_diameter)

# ----
# 3. Rebuild
# try with circular sections
# or geometric sections
compas_draw_15 = COMPASDraw(cg=centerline.geometric_section)  # -> rg; disabled; same code as compas_draw
compas_draw_16 = COMPASDraw(cg=centerline.circular_section)  # -> rg; disabled; same code as compas_draw
align_curve_seams = AlignCurveSeams(Curves=compas_draw_15, Snap=False, Iterative=True)  # -> Aligned, Points, ResultBoolean; disabled
number_slider_2 = Slider(8, range=0..10)  # disabled
loft_options = LoftOptions(Closed=False, Adjust=False, Rebuild=number_slider_2, Refit=0, Type=0)  # disabled
loft = Loft(Curves=align_curve_seams.Aligned, Options=loft_options)  # disabled
number_slider_3 = Slider(10, range=5..30)  # disabled
number_slider_4 = Slider(10, range=5..30)  # disabled
mesh_surface = MeshSurface(Surface=loft, UCount=number_slider_3, VCount=number_slider_4, Overhang=True, Equalize=False)  # disabled
colour_swatch = ColourSwatch(SwatchColor=RGB(238, 255, 0))  # disabled
colour_swatch_2 = ColourSwatch(SwatchColor=RGB(102, 0, 255))  # disabled
colour_swatch_3 = ColourSwatch(SwatchColor=RGB(0, 255, 60))  # disabled
merge = Merge(Data1=colour_swatch, Data2=colour_swatch_2, Data3=colour_swatch_3)  # -> graft(Result); disabled
custom_preview = CustomPreview(Geometry=mesh_surface, Material=merge)  # disabled
