# Grasshopper definition process_branch.ghx (Grasshopper 1.0.8)

mesh_branch_tube = Mesh(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)
mesh_fork_kevin = Mesh(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)
simple_fork = Mesh(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)
triremesh = TriRemesh(Geometry=mesh_fork_kevin, Length=Slider(10, range=0..10), Iterations=25)  # -> Triangulation, Dual, Creases
preprocess = Python3Script(mesh=triremesh.Triangulation)  # -> out, branch, mesh_origin, bounding_box, is_fork; inputs mesh: Mesh
# ---------- preprocess: Python ----------
#! python 3
# venv: forkwork
# r: compas, compas_cgal

#locate file in the same folder
from compas_rhino import unload_modules
from compas_rhino.conversions import mesh_to_compas, vector_to_rhino, point_to_rhino
import sys
import os

import compas_cgal

print(compas_cgal.__version__)

#get current file path
path = ghenv.Component.OnPingDocument().FilePath
print (path)
#get parent directory of the parent directory
parentdir = os.path.dirname(path)
print (parentdir)
#get src folder which contains classes
dire = os.path.join(parentdir,'src')
print (dire)

sys.path.append(dire)

unload_modules('branch')
unload_modules('mesh_utils')
unload_modules('graph_utils')
unload_modules('centerline')


from branch import Branch
import mesh_utils
import graph_utils

from compas.geometry import Polyline, Line

c_mesh = mesh_to_compas(mesh)

branch = Branch(c_mesh)
branch.preprocess()
mesh_origin = branch.mesh
bounding_box = branch.bounding_box()
centerline = branch.skeleton_polylines()
is_fork = True if branch.number_of_end_points() > 2 else False
# ---------- end preprocess ----------
compas_draw = COMPASDraw(cg=preprocess.mesh_origin)  # -> rg
#   port cg: The COMPAS geometry or datastructure to be drawn.
#   port rg: The Rhino geometry object.
# ---------- compas_draw: Python ----------
# r: compas>=2.8.1
"""
Draws COMPAS geometry in Grasshopper.
"""

from typing import Any

import Grasshopper

from compas.scene import SceneObject


class CompasToRhinoGeometry(Grasshopper.Kernel.GH_ScriptInstance):
    def RunScript(self, cg):
        if not cg:
            return None

        return SceneObject(item=cg).draw()
# ---------- end compas_draw ----------
compas_draw_2 = COMPASDraw(cg=preprocess.bounding_box)  # -> rg; same code as compas_draw
panel = Panel(preprocess.is_fork)
# Debug Helper
debug = Python3Script(branch=preprocess.branch)  # -> out, skeleton, skeleton_bifurcation_pt, computed_bifurcation_pt, bifurcation_angle, bifurcation_graph, contours, max_inscribed_circles; disabled
# ---------- debug: Python ----------
#locate file in the same folder
from compas_rhino import unload_modules
from compas_rhino.conversions import mesh_to_compas, vector_to_rhino, point_to_rhino
import sys
import os

from ghpythonlib.treehelpers import list_to_tree

import compas_cgal

print(compas_cgal.__version__)

#get current file path
path = ghenv.Component.OnPingDocument().FilePath
print (path)
#get parent directory of the parent directory
parentdir = os.path.dirname(path)
print (parentdir)
#get src folder which contains classes
dire = os.path.join(parentdir,'src')
print (dire)

sys.path.append(dire)

unload_modules('branch')
unload_modules('mesh_utils')
unload_modules('graph_utils')
unload_modules('growth_center')


from branch import Branch
import mesh_utils
import graph_utils
import growth_center

if branch.is_bifurcation:
    skeleton_trunk = branch.skeleton_trunk_lines()
    skeleton_axis_1, skeleton_axis_2 = branch.skeleton_branching_lines()
    skeleton = [skeleton_trunk, skeleton_axis_1, skeleton_axis_2]
else:
    skeleton = branch.skeleton_polylines()


skeleton_bifurcation_pt = branch.bifurcation_point() if branch.is_bifurcation else None

computed_bifurcation_pt = branch.compute_bifurcation_point(tolerance=5.0) if branch.is_bifurcation else None

bifurcation_angle = branch.skeleton_bifurcation_angle() if branch.is_bifurcation else None

bifurcation_graph = branch.true_bifurcation_graph_lines() if branch.is_bifurcation else None

if branch.is_bifurcation:
    contours_dict = branch._contours(graph=branch.true_bifurcation_graph(), resolution=30.0)
    contours = [contours_dict[0], contours_dict[1], contours_dict[2]]
    contours = list_to_tree(contours)
else:
    contours = branch._contours_tubular(graph=branch.tubular_skeleton_graph(), resolution=30.0)

_, max_inscribed_circles = branch.growth_centerline()
max_inscribed_circles = list_to_tree(max_inscribed_circles)
# ---------- end debug ----------
centerline = Python3Script(branch=preprocess.branch)  # -> out, geometric_centerline, geometric_section, growth_centerline, circular_section, section_diameter, bifurcation_point
# ---------- centerline: Python ----------
#locate file in the same folder
from compas_rhino import unload_modules
from compas_rhino.conversions import mesh_to_compas, vector_to_rhino, point_to_rhino
import sys
import os

from ghpythonlib.treehelpers import list_to_tree

import compas_cgal

print(compas_cgal.__version__)

#get current file path
path = ghenv.Component.OnPingDocument().FilePath
print (path)
#get parent directory of the parent directory
parentdir = os.path.dirname(path)
print (parentdir)
#get src folder which contains classes
dire = os.path.join(parentdir,'src')
print (dire)

sys.path.append(dire)

unload_modules('branch')
unload_modules('mesh_utils')
unload_modules('graph_utils')
unload_modules('growth_center')


from branch import Branch
import mesh_utils
import graph_utils
import growth_center

from compas.geometry import Polyline, Line


bifurcation_point = branch.compute_bifurcation_point() if branch.is_bifurcation else None

geometric_centerline, sections_geometric = branch.geometric_centerline()
growth_centerline, sections_circular = branch.growth_centerline()
geometric_section = list_to_tree(sections_geometric)
section_diameter = []
for axis in sections_circular:
    if branch.is_bifurcation:
        axis_diameters = []
        for c in axis:
            axis_diameters.append(c.radius * 2)
        section_diameter.append(axis_diameters)
    else:
        section_diameter.append(axis.radius * 2)

circular_section = list_to_tree(sections_circular)
section_diameter = list_to_tree(section_diameter)
# ---------- end centerline ----------
compas_draw_3 = COMPASDraw(cg=centerline.geometric_centerline)  # -> rg; same code as compas_draw
compas_draw_4 = COMPASDraw(cg=centerline.geometric_section)  # -> rg; same code as compas_draw
compas_draw_5 = COMPASDraw(cg=centerline.growth_centerline)  # -> rg; same code as compas_draw
compas_draw_6 = COMPASDraw(cg=centerline.circular_section)  # -> rg; same code as compas_draw
compas_draw_7 = COMPASDraw(cg=centerline.bifurcation_point)  # -> rg; same code as compas_draw
compas_draw_8 = COMPASDraw(cg=debug.skeleton_bifurcation_pt)  # -> rg; disabled; same code as compas_draw
compas_draw_9 = COMPASDraw(cg=debug.computed_bifurcation_pt)  # -> rg; disabled; same code as compas_draw
compas_draw_10 = COMPASDraw(cg=debug.bifurcation_graph)  # -> rg; disabled; same code as compas_draw
compas_draw_11 = COMPASDraw(cg=debug.contours)  # -> rg; disabled; same code as compas_draw
compas_draw_12 = COMPASDraw(cg=debug.max_inscribed_circles)  # -> rg; disabled; same code as compas_draw
compas_draw_13 = COMPASDraw(cg=debug.skeleton)  # -> rg; disabled; same code as compas_draw
panel_2 = Panel(debug.bifurcation_angle)  # disabled
panel_3 = Panel(centerline.section_diameter)
